# Grasshopper definition 1122.gh (Grasshopper 1.0.7)
# plug-ins: Axolotl Info

number_slider = Slider(82.5, range=50..250)

pt = ConstructPoint(XCoordinate=0, YCoordinate=0, ZCoordinate=0)
xy = XYPlane(Origin=pt)
data = Data(xy)

number_slider_2 = Slider(25, range=1..250)
thickness = Slider(2.5, range=0..50)

X = Data(Slider(62.5, range=50..250))
R = Data(Slider(0, range=0..10))
thickness_2 = Number(thickness)
Y = Data(Slider(95, range=50..250))
Z = Data(number_slider_2)

Y_2 = Data(Y)
pln = Plane(data)
X_2 = Data(X)
Z_2 = Data(Z)

Y_3 = Data(Y)
pln_2 = Plane(data)
X_3 = Data(X)
Z_3 = Data(Z)

X_4 = Data(X)
Y_4 = Data(Y)
pln_3 = Plane(data)

Z_4 = Data(Z)

Z_5 = UnitZ(Factor=expr("x/2", "5"))
move = Move(Geometry=pln, Motion=Z_5)  # -> Geometry, Transform
subtraction = Subtraction(A=X_2, B="5")
subtraction_2 = Subtraction(A=Y_2, B="5")
box = CenterBox(Base=move.Geometry, X=expr("x/2", subtraction), Y=expr("x/2", subtraction_2), Z=expr("x/2", Z_2))
box_2 = Box(DimensionX=subtraction, DimensionY=subtraction_2, DimensionZ=Z_2, Radius=0, Plane=move.Geometry)

box_3 = CenterBox(Base=pln_3, X=expr("x/2", X_4), Y=expr("x/2", Y_4), Z=expr("x/2", Z_4))
box_4 = Box(DimensionX=X_4, DimensionY=Y_4, DimensionZ=Z_4, Radius=0, Plane=pln_3)

debrep = DeconstructBrep(Brep=box_3)  # -> Faces, Edges, Vertices
debrep_2 = DeconstructBrep(Brep=debrep.Faces)  # -> Faces, Edges, Vertices
plfit = PlaneFit(Points=debrep_2.Vertices)  # -> flatten(Plane), Deviation

item = ListItem(List=plfit.Plane, Index=Slider(1, range=0..5), Wrap=True)

pt_2 = ConstructPoint(XCoordinate=0, YCoordinate=0, ZCoordinate=Slider(-21, range=-100..0))
xy_2 = XYPlane(Origin=pt_2)
data_2 = Data(xy_2)

# ----
# Overall Volume
distance_object_00 = Data(box_4)

number_slider_3 = Slider(0, range=0..10)

number_slider_4 = Slider(0, range=0..10)

X_5 = Data(Slider(22.75, range=5..250))
Y_5 = Data(Slider(12.5, range=5..250))
Z_6 = Data(Slider(10, range=1..250))
pln_4 = Plane(item)

X_6 = Data(Slider(15, range=5..250))
Y_6 = Data(Slider(12.5, range=5..250))
Z_7 = Data(Slider(25, range=1..250))
pln_5 = Plane(item)

# ----
# Volume Substraction 01
distance_object_01 = Data(box_2)

Y_7 = UnitY(Factor=Slider(-13, range=-20..20))
Z_8 = UnitZ(Factor=Slider(2.5, range=-20..20))
move_2 = Move(Geometry=pln_4, Motion=Y_7)  # -> Geometry, Transform
subtraction_3 = Subtraction(A=X_5, B="5")
subtraction_4 = Subtraction(A=Y_5, B="5")
move_3 = Move(Geometry=move_2.Geometry, Motion=Z_8)  # -> Geometry, Transform
box_5 = CenterBox(Base=move_3.Geometry, X=expr("x/2", subtraction_3), Y=expr("x/2", subtraction_4), Z=expr("x/2", Z_6))
box_6 = Box(DimensionX=subtraction_3, DimensionY=subtraction_4, DimensionZ=Z_6, Radius=0, Plane=move_3.Geometry)

Y_8 = UnitY(Factor=Slider(24, range=-20..40))
Z_9 = UnitZ(Factor=Slider(2.5, range=-20..20))
move_4 = Move(Geometry=pln_5, Motion=Y_8)  # -> Geometry, Transform
subtraction_5 = Subtraction(A=X_6, B="5")
subtraction_6 = Subtraction(A=Y_6, B="5")
move_5 = Move(Geometry=move_4.Geometry, Motion=Z_9)  # -> Geometry, Transform
box_7 = CenterBox(Base=move_5.Geometry, X=expr("x/2", subtraction_5), Y=expr("x/2", subtraction_6), Z=expr("x/2", Z_7))
box_8 = Box(DimensionX=subtraction_5, DimensionY=subtraction_6, DimensionZ=Z_7, Radius=0, Plane=move_5.Geometry)

Y_9 = Data(Slider(82.5, range=50..250))
pln_6 = Plane(data_2)
X_7 = Data(Slider(62.5, range=50..250))
Z_10 = Data(Slider(25, range=1..250))

Z_11 = UnitZ(Factor=expr("x/2", "5"))
move_6 = Move(Geometry=pln_6, Motion=Z_11)  # -> Geometry, Transform
subtraction_7 = Subtraction(A=X_7, B="5")
subtraction_8 = Subtraction(A=Y_9, B="5")
box_9 = CenterBox(Base=move_6.Geometry, X=expr("x/2", subtraction_7), Y=expr("x/2", subtraction_8), Z=expr("x/2", Z_10))
box_10 = Box(DimensionX=subtraction_7, DimensionY=subtraction_8, DimensionZ=Z_10, Radius=0, Plane=move_6.Geometry)

pt_3 = ConstructPoint(XCoordinate=Slider(8, range=-10..10), YCoordinate=Slider(-12.65, range=-15..10), ZCoordinate=Slider(-5.5, range=-10..10))
xy_3 = XYPlane(Origin=pt_3)
data_3 = Data(xy_3)

pt_4 = ConstructPoint(XCoordinate=Slider(-12.5, range=-15..10), YCoordinate=Slider(11.5, range=-15..20), ZCoordinate=Slider(3, range=-10..10))
xy_4 = XYPlane(Origin=pt_4)
data_4 = Data(xy_4)

# ----
# MICRO USB  Opening
distance_object_01_2 = Data(box_6)

# ----
# Slide switch  Opening
distance_object_01_3 = Data(box_8)

number_slider_5 = Slider(50, range=0..100)

number_slider_6 = Slider(0, range=0..10)

number_slider_7 = Slider(0, range=0..10)

# ----
# Volume Substraction 01
distance_object_01_4 = Data(box_10)

Y_10 = Data(Y)
Z_12 = Data(number_slider_5)
pln_7 = Plane(data)
X_8 = Data(X)

X_9 = Data(Slider(32.5, range=5..250))
Y_11 = Data(Slider(22.5, range=5..250))
Z_13 = Data(Slider(34, range=1..250))
pln_8 = Plane(data_4)

X_10 = Data(Slider(42, range=5..250))
Y_12 = Data(Slider(32, range=5..250))
Z_14 = Data(Slider(27, range=1..250))
pln_9 = Plane(data_3)

Z_15 = UnitZ(Factor=expr("x/2", "5"))
move_7 = Move(Geometry=pln_8, Motion=Z_15)  # -> Geometry, Transform
subtraction_9 = Subtraction(A=X_9, B="5")
subtraction_10 = Subtraction(A=Y_11, B="5")
box_11 = CenterBox(Base=move_7.Geometry, X=expr("x/2", subtraction_9), Y=expr("x/2", subtraction_10), Z=expr("x/2", Z_13))
box_12 = Box(DimensionX=subtraction_9, DimensionY=subtraction_10, DimensionZ=Z_13, Radius=0, Plane=move_7.Geometry)

Z_16 = UnitZ(Factor=expr("x/2", "5"))
move_8 = Move(Geometry=pln_9, Motion=Z_16)  # -> Geometry, Transform
subtraction_11 = Subtraction(A=X_10, B="5")
subtraction_12 = Subtraction(A=Y_12, B="5")
box_13 = CenterBox(Base=move_8.Geometry, X=expr("x/2", subtraction_11), Y=expr("x/2", subtraction_12), Z=expr("x/2", Z_14))
box_14 = Box(DimensionX=subtraction_11, DimensionY=subtraction_12, DimensionZ=Z_14, Radius=0, Plane=move_8.Geometry)

number_slider_8 = Slider(1, range=0..10)

sdiff = SolidDifference(BrepsA=box_3, BrepsB=box)
boolean_subtract = BooleanSubtract(DistanceObject=distance_object_00, DistanceObject_2=distance_object_01)

number_slider_9 = Slider(11.75, range=-10..20)
expression = Expression(x=Z, y=number_slider_8, Expression="(x/2)-y")
number_slider_10 = Slider(17, range=0..100)
number_slider_11 = Slider(17, range=0..100)
pt_5 = ConstructPoint(XCoordinate=Slider(-1, range=-15..10), YCoordinate=Slider(-17.5, range=-20..20), ZCoordinate=expression)
xy_5 = XYPlane(Origin=pt_5)
dom = ConstructDomain(DomainStart=expr("-x", number_slider_10), DomainEnd=number_slider_10)
dom_2 = ConstructDomain(DomainStart=expr("-x", number_slider_11), DomainEnd=number_slider_11)
dom_3 = ConstructDomain(DomainStart=expr("-x", number_slider_8), DomainEnd=number_slider_8)
data_5 = Data(xy_5)

# ----
# DHT Volume
distance_object_01_5 = Data(box_12)

# ----
# MCU Volume
distance_object_01_6 = Data(box_14)

Y_13 = Data(subtraction_10)
Z_17 = Data(Z_13)
pln_10 = Plane(data_4)
X_11 = Data(subtraction_9)

rectangle = Rectangle(Plane=data_5, XSize=dom, YSize=dom_2, Radius=0)  # -> Rectangle, Length

addition = Addition(A=Z_17, B=Slider(-21, range=-50..10))
Z_18 = UnitZ(Factor=expr("x/2", "5"))
move_9 = Move(Geometry=pln_10, Motion=Z_18)  # -> Geometry, Transform
addition_2 = Addition(A=Y_13, B="3.5")
addition_3 = Addition(A=X_11, B="3.5")
box_15 = CenterBox(Base=move_9.Geometry, X=expr("x/2", addition_3), Y=expr("x/2", addition_2), Z=expr("x/2", addition))
box_16 = Box(DimensionX=addition_3, DimensionY=addition_2, DimensionZ=addition, Radius=0, Plane=move_9.Geometry)

pt_6 = ConstructPoint(XCoordinate=Slider(15, range=-10..20), YCoordinate=Slider(18, range=-15..20), ZCoordinate=Slider(-5.5, range=-10..10))
xy_6 = XYPlane(Origin=pt_6)
data_6 = Data(xy_6)

box_17 = CenterBox(Base=data_5, X=expr("x/2", dom), Y=expr("x/2", dom_2), Z=expr("x/2", dom_3))
box_18 = Box(DimensionX=dom, DimensionY=dom_2, DimensionZ=dom_3, Radius=0, Plane=data_5)

box_19 = Box(box_17)
debox = DeconstructBox(Box=box_19)  # -> Plane, X, Y, Z
volume = Volume(Geometry=box_19)  # -> Volume, Centroid
box_20 = Box(DimensionX=debox.X, DimensionY=debox.Y, DimensionZ=debox.Z, Radius=0, Plane=volume.Centroid)

number_slider_12 = Slider(0, range=0..10)

number_slider_13 = Slider(0, range=0..10)

number_slider_14 = Slider(0, range=0..10)

# ----
# DHT Volume Wall
distance_object_01_7 = Data(box_16)

Y_14 = Data(Slider(32, range=5..250))
pln_11 = Plane(data_6)
X_12 = Data(Slider(21.83, range=5..250))
Z_19 = Data(Slider(27, range=1..250))

Z_20 = UnitZ(Factor=expr("x/2", "5"))
move_10 = Move(Geometry=pln_11, Motion=Z_20)  # -> Geometry, Transform
subtraction_13 = Subtraction(A=X_12, B="5")
subtraction_14 = Subtraction(A=Y_14, B="5")
box_21 = CenterBox(Base=move_10.Geometry, X=expr("x/2", subtraction_13), Y=expr("x/2", subtraction_14), Z=expr("x/2", Z_19))
box_22 = Box(DimensionX=subtraction_13, DimensionY=subtraction_14, DimensionZ=Z_19, Radius=0, Plane=move_10.Geometry)

number_slider_15 = Slider(20, range=0..100)
number_slider_16 = Slider(20, range=0..100)

# ----
# TPMS Lattice structure
number_slider_17 = Slider(5.4, range=0..10)
tpms = TPMS(Wavelength=number_slider_17, type=0)
shell = Shell(DistanceObject=tpms, Thickness=Slider(2, range=0..10), Factor=0.5)

pt_7 = ConstructPoint(XCoordinate=Slider(-11, range=-15..10), YCoordinate=Slider(11.5, range=-15..20), ZCoordinate=Slider(3, range=-10..10))
pt_8 = ConstructPoint(XCoordinate=Slider(-24, range=-25..10), YCoordinate=Slider(11.5, range=-15..20), ZCoordinate=Slider(5, range=-10..10))
xy_7 = XYPlane(Origin=pt_7)
xy_8 = XYPlane(Origin=pt_8)
data_7 = Data(xy_7)

X_13 = Data(Slider(28.02, range=5..250))
Y_15 = Data(Slider(22.5, range=5..250))
Z_21 = Data(Slider(34, range=1..250))
pln_12 = Plane(data_7)

Z_22 = UnitZ(Factor=expr("x/2", "5"))
move_11 = Move(Geometry=pln_12, Motion=Z_22)  # -> Geometry, Transform
subtraction_15 = Subtraction(A=X_13, B="5")
subtraction_16 = Subtraction(A=Y_15, B="5")
box_23 = CenterBox(Base=move_11.Geometry, X=expr("x/2", subtraction_15), Y=expr("x/2", subtraction_16), Z=expr("x/2", Z_21))
box_24 = Box(DimensionX=subtraction_15, DimensionY=subtraction_16, DimensionZ=Z_21, Radius=0, Plane=move_11.Geometry)

data_8 = Data(xy_8)

Y_16 = Data(Slider(24, range=5..250))
pln_13 = Plane(data_8)
X_14 = Data(Slider(10, range=5..250))
Z_23 = Data(Slider(12, range=1..250))

Z_24 = UnitZ(Factor=expr("x/2", "5"))
move_12 = Move(Geometry=pln_13, Motion=Z_24)  # -> Geometry, Transform
subtraction_17 = Subtraction(A=X_14, B="5")
subtraction_18 = Subtraction(A=Y_16, B="5")
box_25 = CenterBox(Base=move_12.Geometry, X=expr("x/2", subtraction_17), Y=expr("x/2", subtraction_18), Z=expr("x/2", Z_23))
box_26 = Box(DimensionX=subtraction_17, DimensionY=subtraction_18, DimensionZ=Z_23, Radius=0, Plane=move_12.Geometry)

# ----
# Switch Volume
distance_object_01_8 = Data(box_22)

# ----
# DHT Cutout
distance_object_01_9 = Data(box_24)

# ----
# DHT Cutout
distance_object_01_10 = Data(box_26)

boolean_subtract_2 = BooleanSubtract(DistanceObject=distance_object_01_7, DistanceObject_2=distance_object_01_5)
sdiff_2 = SolidDifference(BrepsA=box_15, BrepsB=box_11)

pt_9 = ConstructPoint(XCoordinate=Slider(-14, range=-20..10), YCoordinate=Slider(28, range=-15..40), ZCoordinate=Slider(3, range=-10..10))
xy_9 = XYPlane(Origin=pt_9)
data_9 = Data(xy_9)

pt_10 = ConstructPoint(XCoordinate=Slider(-14, range=-20..10), YCoordinate=Slider(28, range=-15..40), ZCoordinate=Slider(3, range=-10..10))
xy_10 = XYPlane(Origin=pt_10)
data_10 = Data(xy_10)

number_slider_18 = Slider(10, range=1..250)
number_slider_19 = Slider(0, range=0..10)

number_slider_20 = Slider(10, range=1..250)
number_slider_21 = Slider(0, range=0..10)

crv = Curve(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)
disc = Discontinuity(Curve=crv, Level=1)  # -> Points, Parameters
pdecon = Deconstruct(Point=disc.Points)  # -> XComponent, YComponent, ZComponent
panel = Panel(Slider(-7, range=-10..10))
subtraction_19 = Subtraction(A=panel)
subtraction_20 = Subtraction(A=panel, C=Slider(4, range=0..10))
pt_11 = ConstructPoint(XCoordinate=pdecon.XComponent, YCoordinate=pdecon.YComponent, ZCoordinate=subtraction_19)
pt_12 = ConstructPoint(XCoordinate=pdecon.XComponent, YCoordinate=pdecon.YComponent, ZCoordinate=subtraction_20)

Y_17 = Data(Slider(25, range=1..100))
pln_14 = Plane(data_9)
X_15 = Data(Slider(3.5, range=1..10))

addition_4 = Addition(A=X_15, B="2.5")

Y_18 = Data(Slider(17, range=1..100))
pln_15 = Plane(data_10)
X_16 = Data(addition_4)

neg = Negative(Value=Y_17)
merge = Merge(Data1=Y_17, Data2=neg)

neg_2 = Negative(Value=Y_18)
merge_2 = Merge(Data1=Y_18, Data2=neg_2)

cyl = Cylinder(Base=pln_14, Radius=X_15, Length=expr("x/2", graft(merge)))
cylinder = Cylinder(Radius=X_15, Height=Y_17, Plane=pln_14, Fillet=0)

cyl_2 = Cylinder(Base=pln_15, Radius=X_16, Length=expr("x/2", graft(merge_2)))
cylinder_2 = Cylinder(Radius=X_16, Height=Y_18, Plane=pln_15, Fillet=0)

# ----
# LED Wall
sunion = SolidUnion(Breps=flatten(cyl_2))
distance_object_01_11 = Data(cylinder_2)
fmerge = MergeFaces(Brep=sunion)  # -> Breps, Before, After
cap = CapHoles(Brep=fmerge.Breps)

sunion_2 = SolidUnion(Breps=flatten(cyl))

# ----
# LED Cutout
distance_object_01_12 = Data(cylinder)
cap_2 = CapHoles(Brep=sunion_2)

number_slider_22 = Slider(150, range=0..150)
number_slider_23 = Slider(100, range=0..100)
number_slider_24 = Slider(100, range=0..100)
# Bounding box
neg_3 = Negative(Value=number_slider_24)
neg_4 = Negative(Value=number_slider_22)
neg_5 = Negative(Value=number_slider_23)
dom_4 = ConstructDomain(DomainStart=neg_3, DomainEnd=number_slider_24)
dom_5 = ConstructDomain(DomainStart=neg_4, DomainEnd=number_slider_22)
dom_6 = ConstructDomain(DomainStart=neg_5, DomainEnd=number_slider_23)
box_27 = CenterBox(Base=PlaneXY(0, 0, 0), X=expr("x/2", dom_4), Y=expr("x/2", dom_5), Z=expr("x/2", dom_6))
box_28 = DomainBox(Base=PlaneXY(0, 0, 0), X=dom_4, Y=dom_5, Z=dom_6)

edges = BrepEdges(Brep=box_28)  # -> Naked, Interior, NonManifold
debox_2 = DeconstructBox(Box=box_28)  # -> Plane, X, Y, Z

# ----
# Resolution from voxel size
number_slider_25 = Slider(0.325, range=0..1)
voxel_size = VoxelSize(BoundingBox=box_28, UnitCell=number_slider_25)  # -> NumberX, NumberY, NumberZ

# ----
# Toggle b/n high and low resolution Mesh
toggle = BooleanToggle(False)
panel_2 = Panel(voxel_size.NumberX)
filter = StreamFilter(Gate=toggle, Stream0="150", Stream1=panel_2)
panel_3 = Panel(filter)

panel_4 = Panel([voxel_size.NumberX, voxel_size.NumberY, voxel_size.NumberZ])

# ----
# Volume Substraction 02
thickness_of_acrylic = Slider(2, range=0..10)

subtraction_21 = Subtraction(A=number_slider_2, B=thickness_of_acrylic)
Z_25 = UnitZ(Factor=subtraction_21)
move_13 = Move(Geometry=pln_2, Motion=Z_25)  # -> Geometry, Transform
subtraction_22 = Subtraction(A=X_3, B="0")
subtraction_23 = Subtraction(A=Y_3, B="0")
box_29 = CenterBox(Base=move_13.Geometry, X=expr("x/2", subtraction_22), Y=expr("x/2", subtraction_23), Z=expr("x/2", Z_3))
box_30 = Box(DimensionX=subtraction_22, DimensionY=subtraction_23, DimensionZ=Z_3, Radius=0, Plane=move_13.Geometry)

distance_object_02 = Data(box_30)

sdiff_3 = SolidDifference(BrepsA=sdiff, BrepsB=box_29)
boolean_subtract_3 = BooleanSubtract(DistanceObject=boolean_subtract, DistanceObject_2=distance_object_02)

boolean_intersect = BooleanIntersect(DistanceObjectS=distance_object_00, DistanceObject=distance_object_02)
sint = SolidIntersection(BrepsA=box_3, BrepsB=box_29)

sdiff_4 = SolidDifference(BrepsA=sdiff_3, BrepsB=box_5)
boolean_subtract_4 = BooleanSubtract(DistanceObject=boolean_subtract_3, DistanceObject_2=distance_object_01_2)

sdiff_5 = SolidDifference(BrepsA=sdiff_4, BrepsB=box_7)
boolean_subtract_5 = BooleanSubtract(DistanceObject=boolean_subtract_4, DistanceObject_2=distance_object_01_3)

Z_26 = Data(number_slider_5)
pln_16 = Plane(data)

# ----
# Volume Substraction 01
number_slider_26 = Slider(17.5, range=0..100)

Z_27 = UnitZ(Factor=number_slider_26)
move_14 = Move(Geometry=pln_7, Motion=Z_27)  # -> Geometry, Transform
subtraction_24 = Subtraction(A=X_8, B="5.25")
subtraction_25 = Subtraction(A=Y_10, B="5.25")
box_31 = CenterBox(Base=move_14.Geometry, X=expr("x/2", subtraction_24), Y=expr("x/2", subtraction_25), Z=expr("x/2", Z_12))
box_32 = Box(DimensionX=subtraction_24, DimensionY=subtraction_25, DimensionZ=Z_12, Radius=0, Plane=move_14.Geometry)

Y_19 = Data(subtraction_25)
X_17 = Data(subtraction_24)

distance_object_01_13 = Data(box_32)

# ----
# Volume Substraction 01
number_slider_27 = Slider(15, range=0..100)

Z_28 = UnitZ(Factor=number_slider_27)
move_15 = Move(Geometry=pln_16, Motion=Z_28)  # -> Geometry, Transform
subtraction_26 = Subtraction(A=X_17, B="20")
subtraction_27 = Subtraction(A=Y_19, B="20")
box_33 = CenterBox(Base=move_15.Geometry, X=expr("x/2", subtraction_26), Y=expr("x/2", subtraction_27), Z=expr("x/2", Z_26))
box_34 = Box(DimensionX=subtraction_26, DimensionY=subtraction_27, DimensionZ=Z_26, Radius=0, Plane=move_15.Geometry)

distance_object_01_14 = Data(box_34)

boolean_subtract_6 = BooleanSubtract(DistanceObject=distance_object_01_13, DistanceObject_2=distance_object_01_14)
sdiff_6 = SolidDifference(BrepsA=box_31, BrepsB=box_33)

boolean_union = BooleanUnion(DistanceObjectS=boolean_intersect, DistanceObject=boolean_subtract_6)
sunion_3 = SolidUnion(Breps=[sdiff_6, sint])

boolean_intersect_2 = BooleanIntersect(DistanceObjectS=box_4, DistanceObject=boolean_union)
sint_2 = SolidIntersection(BrepsA=box_3, BrepsB=sunion_3)

sdiff_7 = SolidDifference(BrepsA=sint_2, BrepsB=box_13)
boolean_subtract_7 = BooleanSubtract(DistanceObject=boolean_intersect_2, DistanceObject_2=distance_object_01_6)

sdiff_8 = SolidDifference(BrepsA=sdiff_7, BrepsB=box_11)
boolean_subtract_8 = BooleanSubtract(DistanceObject=boolean_subtract_7, DistanceObject_2=distance_object_01_5)

boolean_subtract_9 = BooleanSubtract(DistanceObject=boolean_subtract_8, DistanceObject_2=distance_object_01_8)
sdiff_9 = SolidDifference(BrepsA=sdiff_8, BrepsB=box_21)

sunion_4 = SolidUnion(Breps=[sdiff_2, sdiff_9])
boolean_union_2 = BooleanUnion(DistanceObjectS=boolean_subtract_2, DistanceObject=boolean_subtract_9)

sdiff_10 = SolidDifference(BrepsA=sunion_4, BrepsB=box_23)
boolean_subtract_10 = BooleanSubtract(DistanceObject=boolean_union_2, DistanceObject_2=distance_object_01_9)

group = Group(Objects=[cap, sdiff_10])
boolean_union_3 = BooleanUnion(DistanceObjectS=boolean_subtract_10, DistanceObject=distance_object_01_11)

sdiff_11 = SolidDifference(BrepsA=sdiff_10, BrepsB=cap_2)
boolean_subtract_11 = BooleanSubtract(DistanceObject=boolean_union_3, DistanceObject_2=distance_object_01_12)

boolean_union_4 = BooleanUnion(DistanceObjectS=boolean_subtract_11, DistanceObject=distance_object_01_10)
boolean_subtract_12 = BooleanSubtract(DistanceObject=boolean_union_4, DistanceObject_2=distance_object_01_4)

boolean_subtract_13 = BooleanSubtract(DistanceObject=boolean_subtract_12, DistanceObject_2=distance_object_01_2)
boolean_subtract_14 = BooleanSubtract(DistanceObject=boolean_subtract_13, DistanceObject_2=distance_object_01_3)

boolean_subtract_15 = BooleanSubtract(DistanceObject=boolean_subtract_14, DistanceObject_2=box_18)

# ----
# Vent Grill
Z_29 = UnitZ(Factor=1)
number_slider_28 = Slider(1.25, range=0..10)
number_slider_29 = Slider(7.5, range=0..10)
plane = Plane(Origin=volume.Centroid, Normal=Z_29)

# ----
# Gradient thickening
number_slider_30 = Slider(0.004, range=0..0.01)
overlay = Overlay(DistanceObject=shell, DistanceObject_2=plane, Factor=number_slider_30)

# ----
# Body  taper
number_slider_31 = Slider(0, range=-0.02..0)
overlay_2 = Overlay(DistanceObject=box_20, DistanceObject_2=plane, Factor=number_slider_31)

boolean_intersect_3 = BooleanIntersect(DistanceObjectS=overlay_2, DistanceObject=overlay)

boolean_union_5 = BooleanUnion(DistanceObjectS=boolean_subtract_15, DistanceObject=boolean_intersect_3)

# ----
# Clean the object
overall_filleted_volume = Data(distance_object_00)
boolean_intersect_4 = BooleanIntersect(DistanceObjectS=overall_filleted_volume, DistanceObject=boolean_union_5)

dam = DataDam(DataA=boolean_intersect_4, BufferDelay=10000000, BufferMode=0)
isosurface_distancefunction = IsosurfaceDistancefunction(
    BoundingBox=box_28,
    NumberX=filter,
    NumberY=filter,
    NumberZ=filter,
    Isovalue=0,
    Capped=False,
    DistanceObject=dam,
    Refine=True)
mesh = Mesh(isosurface_distancefunction)

screw_type_m_diameter = Panel("2")
number_slider_32 = Slider(2.85, range=0..20)
H = Data(number_slider_32)
addition_5 = Addition(A=number_slider_32, B="3.75")
R_2 = Number(expr("x/2", screw_type_m_diameter))
thickness_3 = Number(screw_type_m_diameter)

# ----
# Screw Hole Tube Thickness
H_2 = Number(H)
neg_6 = Negative(Value=H_2)
merge_3 = Merge(Data1=H_2, Data2=neg_6)

# ----
# Screw Hole Tube
pln_17 = Plane(pt_11)
cylinder_3 = Cylinder(Radius=R_2, Height=H_2, Plane=pln_17, Fillet=0)

H_3 = Number(addition_5)
neg_7 = Negative(Value=H_3)
merge_4 = Merge(Data1=H_3, Data2=neg_7)

cyl_3 = Cylinder(Base=pln_17, Radius=R_2, Length=expr("x/2", graft(merge_3)))

smoothunionlist = SmoothUnionList(DistanceObjects=cylinder_3, SmoothingFactor=5)
cap_3 = CapHoles(Brep=cyl_3)

sunion_5 = SolidUnion(Breps=flatten(cap_3))
boolean_union_6 = BooleanUnion(DistanceObjectS=boolean_subtract_5, DistanceObject=smoothunionlist)

pln_18 = Plane(pt_12)

addition_6 = Addition(A=R_2, B=Slider(0.5, range=0..2.5), C=Slider(0.25, range=0..2.5))
cyl_4 = Cylinder(Base=pln_18, Radius=addition_6, Length=expr("x/2", graft(merge_4)))

cylinder_4 = Cylinder(Radius=addition_6, Height=H_3, Plane=pln_18, Fillet=0)

cap_4 = CapHoles(Brep=cyl_4)
smoothunionlist_2 = SmoothUnionList(DistanceObjects=cylinder_4, SmoothingFactor=5)

boolean_union_7 = BooleanUnion(DistanceObjectS=boolean_union_6, DistanceObject=smoothunionlist_2)

# ----
# Clean the object
overall_filleted_volume_2 = Data(distance_object_00)
boolean_intersect_5 = BooleanIntersect(DistanceObjectS=overall_filleted_volume_2, DistanceObject=boolean_union_7)

dam_2 = DataDam(DataA=boolean_intersect_5, BufferDelay=10000000, BufferMode=0)
isosurface_distancefunction_2 = IsosurfaceDistancefunction(
    BoundingBox=box_28,
    NumberX=filter,
    NumberY=filter,
    NumberZ=filter,
    Isovalue=0,
    Capped=False,
    DistanceObject=dam_2,
    Refine=True)
mesh_2 = Mesh(isosurface_distancefunction_2)
